% Simulink data dictionary BLDC57.sldd

a_lbg_theta = Simulink.Signal(StorageClass="ExportedGlobal", DataType="single")
a_lbg_speed = Simulink.Signal(StorageClass="ExportedGlobal")
a_eletarget = Simulink.Parameter(0.2, StorageClass="ExportedGlobal")
a_realiq = Simulink.Signal(StorageClass="ExportedGlobal", DataType="single")
a_reaid = Simulink.Signal(StorageClass="ExportedGlobal", DataType="single")
eleloop_param = Simulink.Parameter(struct(kp=0, ki=0, kd=0, target=0.6), StorageClass="ExportedGlobal", DataType="Bus: pid_t")

pid_t = Simulink.Bus()
  kp: single
  ki: single
  kd: single
  target: single